# Dynamo graph 广州塔.dyn (Dynamo 2.13.1.3887)

# group: 生成上下两个圆
圆半径 = CodeBlock { 50000; }
byCenterPointRadius = Circle.ByCenterPointRadius(radius=圆半径)
塔身高 = CodeBlock { 600000; }
translate = Geometry.Translate(geometry=byCenterPointRadius, zTranslation=塔身高)

# group: 两次旋转
centerPoint = Circle.CenterPoint(circle=translate)
ZAxis = Vector.ZAxis()
code_block = CodeBlock { 135; }
rotate = Geometry.Rotate(geometry=translate, origin=centerPoint, axis=ZAxis, degrees=code_block)
YAxis = Vector.YAxis()
code_block_2 = CodeBlock { 15; }
rotate_2 = Geometry.Rotate(geometry=rotate, origin=centerPoint, axis=YAxis, degrees=code_block_2)

# group: 生成斜切平面
code_block_3 = CodeBlock { [0.2,0.4,0.8]; }
pointAtParameter = Curve.PointAtParameter(curve=rotate_2, param=code_block_3)
code_block_4 = CodeBlock(a=pointAtParameter) { a[0]; a[1]; a[2]; }
byThreePoints = Plane.ByThreePoints(origin=code_block_4.out0, planePoint=code_block_4.out1, xAxisPoint=code_block_4.out2)
code_block_5 = CodeBlock { 30; }
code_block_6 = CodeBlock(TowerHeight=塔身高, copies=code_block_5) { 0..TowerHeight..#copies; }
code_block_7 = CodeBlock { -1; }
mul = code_block_6 * code_block_7
translate_2 = Geometry.Translate(geometry=byThreePoints, zTranslation=mul)

# group: 在圆上生成点
list_create = List.Create(item0=byCenterPointRadius, item1=rotate_2)
code_block_8 = CodeBlock { 24; }
code_block_9 = CodeBlock(Part=code_block_8) { 0..1..#Part; }
pointAtParameter_2 = Curve.PointAtParameter(curve=list_create, param=[code_block_9, code_block_9], lacing=CrossProduct)
code_block_10 = CodeBlock { 1; }
dropItems = List.DropItems(list=pointAtParameter_2@L2, amount=code_block_10)

# group: 根据端点生成第一框架的线
code_block_11 = CodeBlock(Table=dropItems) { Table[0]; Table[1]; }
byStartPointEndPoint = Line.ByStartPointEndPoint(startPoint=code_block_11.out0, endPoint=code_block_11.out1)

# group: 生成第二框架的线条
intersect = Geometry.Intersect(geometry=translate_2, other=byStartPointEndPoint, lacing=CrossProduct)
flatten = List.Flatten(list=intersect@L3)
code_block_12 = CodeBlock { true; }
byPoints = PolyCurve.ByPoints(points=flatten, connectLastToFirst=code_block_12)

# group: 生成第三框架的线条
code_block_13 = CodeBlock { -1; }
dropItems_2 = List.DropItems(list=flatten, amount=code_block_13)
count = List.Count(list=dropItems_2)
code_block_14 = CodeBlock(listLength=count) { 0..listLength-1; }
shiftIndices = List.ShiftIndices(list=dropItems_2, amount=code_block_14, lacing=Longest)
transpose = List.Transpose(lists=shiftIndices)
code_block_15 = CodeBlock { true; }
byPoints_2 = PolyCurve.ByPoints(points=transpose, connectLastToFirst=code_block_15)

# group: 生成第一框架的实体
endPoint = Curve.EndPoint(curve=byStartPointEndPoint)
code_block_16 = CodeBlock { 1000; }
byCenterPointRadius_2 = Circle.ByCenterPointRadius(centerPoint=endPoint, radius=code_block_16)
sweepAsSolid = Curve.SweepAsSolid(curve=byCenterPointRadius_2, path=byStartPointEndPoint)

# group: 生成框架2的实体
byPoints_3 = NurbsCurve.ByPoints(points=flatten, closeCurve=code_block_12)
startPoint = Curve.StartPoint(curve=byPoints_3)
code_block_17 = CodeBlock { 500; }
byTangency = Line.ByTangency(curve=byPoints_3)
direction = Line.Direction(line=byTangency)
byCenterPointRadiusNormal = Circle.ByCenterPointRadiusNormal(centerPoint=startPoint, radius=code_block_17, normal=direction)
sweepAsSolid_2 = Curve.SweepAsSolid(curve=byCenterPointRadiusNormal, path=byPoints_3)

# group: 生成框架3的实体
byPoints_4 = NurbsCurve.ByPoints(points=transpose)
endPoint_2 = Curve.EndPoint(curve=byPoints_4)
code_block_18 = CodeBlock { 300; }
byCenterPointRadius_3 = Circle.ByCenterPointRadius(centerPoint=endPoint_2, radius=code_block_18)
sweepAsSolid_3 = Curve.SweepAsSolid(curve=byCenterPointRadius_3, path=byPoints_4)

# group: 在Revit中生成模型
join = List.Join(list0=sweepAsSolid, list1=sweepAsSolid_2, list2=sweepAsSolid_3)
categories = Categories("OST_GenericModel")
code_block_19 = CodeBlock { "不锈钢"; }
byName = Material.ByName(name=code_block_19)
code_block_20 = CodeBlock { "GuangzhouTowerFrames"; }
byGeometry = DirectShape.ByGeometry(geometry=join, category=categories, material=byName, name=code_block_20)
